# Grasshopper definition Bounds.gh (Grasshopper 1.0.8)
# plug-ins: GHOpenCL, GHParallelFlow

number_slider = Slider(500, range=0..1000)
int = Integer(Slider(3, range=0..100))
panel = Panel("""1
2
4
3
1
2
4.5
0.5""")
int_2 = Integer(Slider(2, range=0..10))
int_3 = Integer(Slider(2, range=0..11))
S = Series(S=int_3, N=int_2, C=int)  # -> Kernel, R
int_4 = Integer(Slider(1, range=0..1))
dom = ConstructDomain(A=Slider(0, range=0..100), B=Slider(100, range=0..100))  # -> Kernel, R
int_5 = Integer(Slider(7000, range=0..10000))
num = Number(panel)
ran = Random(Domain=dom.R, Count=S.R, Seed=int_4)  # -> Kernel, R
ran_2 = Random(Domain=dom.R, Count=int_5, Seed=int_4)  # -> Kernel, R
random = Random(Range=Domain(0, 1), Number=1, Seed=2)
listtovector = ListToVector(List=num, Float=False)
bnd = Bounds(N=ran.R)  # -> Kernel, D
vectortolist = VectorToList(Vector=ran.R)
bnd_2 = Bounds(Input=ran_2.R)  # -> Kernel, Input
bnd_3 = Bounds(N=listtovector)  # -> Kernel, D
bnd_4 = Bounds(Numbers=vectortolist)
vectortolist_2 = VectorToList(Vector=bnd.D)
vectortolist_3 = VectorToList(Vector=bnd_2.Input)
computer = Computer(Kernel=bnd.Kernel)
panel_2 = Panel(bnd_4)
panel_3 = Panel(vectortolist_2)
panel_4 = Panel(vectortolist_3)
