# Grasshopper definition OrScan.gh (Grasshopper 1.0.8)
# plug-ins: GHOpenCL, GHParallelFlow

panel = Panel("""0
0
0
1
1
0
0
0
0
1
0
0
1
0""")
bool = Boolean(panel)
listtovector = ListToVector(List=bool, Float=False)
nickname = OrscanTest(X=listtovector)  # -> R, Kernel
computer = Computer(Kernel=nickname.Kernel)
vectortolist = VectorToList(Vector=nickname.R)
panel_2 = Panel(vectortolist)
