# Grasshopper definition PartitionVector.gh (Grasshopper 1.0.8)
# plug-ins: GHOpenCL, GHParallelFlow

number_slider = Slider(1, range=0..1)
number_slider_2 = Slider(0, range=0..100)
int = Integer(Slider(4, range=0..10))
int_2 = Integer(Slider(100, range=0..100))
int_3 = Integer(Slider(6, range=0..10))
int_4 = Integer(Slider(2, range=0..10))
S = Series(S=number_slider_2, N=number_slider, C=int_2)  # -> Kernel, R
series = Series(Start=int_4, Step=int, Count=int_3)
series_2 = Series(Start=number_slider_2, Step=number_slider, Count=int_2)
S_2 = Series(S=int_4, N=int, C=int_3)  # -> Kernel, R
vectortolist = VectorToList(Vector=S_2.R)
partition = PartitionList(List=series_2, Size=series)
part = PartitionList(V=S.R, S=S_2.R)  # -> Kernel, P
panel = Panel(vectortolist)
vectortolist_2 = VectorToList(Vector=part.P)
computer = Computer(Kernel=part.Kernel)
panel_2 = Panel(partition)
panel_3 = Panel(vectortolist_2)
