# Grasshopper definition PartitionVector2.gh (Grasshopper 1.0.8)
# plug-ins: GHOpenCL, GHParallelFlow

panel = Panel("""1
2
3
4
5
6
7
8""")
num = Number(panel)
int = Integer("3")
listtovector = ListToVector(List=num, Float=False)
listtovector_2 = ListToVector(List=int, Float=False)
partition = PartitionList(List=panel, Size="3")
split = SplitList(List=panel, Index="3")  # -> ListA, ListB
part = PartitionList(V=listtovector, S=listtovector_2)  # -> Kernel, P
panel_2 = Panel(partition)
panel_3 = Panel(split.ListA)
vectortolist = VectorToList(Vector=part.P)
computer = Computer(Kernel=part.Kernel)
panel_4 = Panel(vectortolist)
