# Grasshopper definition Range.gh (Grasshopper 1.0.8)
# plug-ins: GHOpenCL, GHParallelFlow

number_slider = Slider(3, range=0..1000)
number_slider_2 = Slider(1, range=0..100)
number_slider_3 = Slider(3, range=0..10)
number_slider_4 = Slider(3, range=0..1000)
number_slider_5 = Slider(3, range=0..1000)
number_slider_6 = Slider(1, range=0..100)
number_slider_7 = Slider(10, range=0..10)
number_slider_8 = Slider(0, range=0..100)
int = Integer(number_slider)
int_2 = Integer(number_slider_4)

S = Series(S=number_slider_6, N=number_slider_7, C=int_2)  # -> Kernel, R; disabled
dom = ConstructDomain(A=number_slider_8, B=S.R, Cross_reference=False)  # -> Kernel, R
int_3 = Integer(number_slider_5)
range = Range(Domain=dom.R, Steps=int_3)  # -> Kernel, R
computer = Computer(Kernel=range.Kernel)

# ----
# GPU
S_2 = Series(S=number_slider_2, N=number_slider_3, C=int)  # -> Kernel, R; disabled
dom_2 = ConstructDomain(A=number_slider_8, B=S_2.R, Cross_reference=False)  # -> Kernel, R
int_4 = Integer(In=S_2.R)  # -> Kernel, R
range_2 = Range(Domain=dom_2.R, Steps=int_4.R)  # -> Kernel, R
computer_2 = Computer(Kernel=range_2.Kernel)

series = Series(Start=number_slider_6, Step=number_slider_7, Count=number_slider_4)
dom_3 = ConstructDomain(DomainStart=number_slider_8, DomainEnd=series)
range_3 = Range(Domain=dom_3, Steps=number_slider_5)

# ----
# CPU
series_2 = Series(Start=number_slider_2, Step=number_slider_3, Count=number_slider)  # disabled
dom_4 = ConstructDomain(DomainStart=number_slider_8, DomainEnd=series_2)
range_4 = Range(Domain=dom_4, Steps=series_2)

vectortolist = VectorToList(Vector=range_2.R)
panel = Panel(range_3)
vectortolist_2 = VectorToList(Vector=range.R)
subtraction = Subtraction(A=vectortolist_2, B=range_3)
panel_2 = Panel(vectortolist)

subtraction_2 = Subtraction(A=vectortolist, B=range_4)
panel_3 = Panel(subtraction_2)

panel_4 = Panel(subtraction)
number_slider_9 = Slider(32, range=2..1000)
number_slider_10 = Slider(1, range=0..100)
number_slider_11 = Slider(5, range=2..10)
dom_5 = ConstructDomain(DomainStart=Slider(0.1, range=0..0.1), DomainEnd=Slider(10, range=0..10))
int_5 = Integer(number_slider_9)
S_3 = Series(S=number_slider_10, N=number_slider_11, C=int_5)  # -> Kernel, R
series_3 = Series(Start=number_slider_10, Step=number_slider_11, Count=number_slider_9)
int_6 = Integer(In=S_3.R)  # -> Kernel, R
range_5 = Range(Domain=dom_5, Steps=int_6.R)  # -> Kernel, R
range_6 = Range(Domain=dom_5, Steps=series_3)
vectortolist_3 = VectorToList(Vector=range_5.R)
computer_3 = Computer(Kernel=range_5.Kernel)
panel_5 = Panel(series_3)
subtraction_3 = Subtraction(A=vectortolist_3, B=range_6)
panel_6 = Panel(subtraction_3)
panel_7 = Panel(vectortolist_3)

# ---- group: Scalar Scalar
# Number of steps
number_slider_12 = Slider(0.1, range=0..0.1)
number_slider_13 = Slider(5, range=0..1000)
dom_6 = ConstructDomain(DomainStart=number_slider_12, DomainEnd=Slider(10, range=0..10))
int_7 = Integer(number_slider_13)
range_7 = Range(Domain=dom_6, Steps=number_slider_13)

# GPU
range_8 = Range(Domain=dom_6, Steps=int_7)  # -> Kernel, R; disabled
computer_4 = Computer(Kernel=range_8.Kernel)

vectortolist_4 = VectorToList(Vector=range_8.R)
panel_8 = Panel(vectortolist_4)

# Validation
subtraction_4 = Subtraction(A=vectortolist_4, B=range_7)
panel_9 = Panel(subtraction_4)
