# Grasshopper definition Series.gh (Grasshopper 1.0.8)
# plug-ins: GHOpenCL, GHParallelFlow

number_slider = Slider(50, range=3..100000)
number_slider_2 = Slider(1, range=0..100)
number_slider_3 = Slider(2, range=0.1..10)
int = Integer(number_slider)

# ----
# CPU
series = Series(Start=number_slider_2, Step=number_slider_3, Count=number_slider)
round = Round(Number=series)  # -> Nearest, Floor, Ceiling
series_2 = Series(Start=number_slider_2, Step=number_slider_3, Count=round.Floor)
series_3 = Series(Start=number_slider_2, Step=series, Count=number_slider)
series_4 = Series(Start=series, Step=number_slider_3, Count=number_slider)
series_5 = Series(Start=series_2, Step=number_slider_3, Count=round.Floor)

# ----
# GPU
S = Series(S=number_slider_2, N=number_slider_3, C=int)  # -> Kernel, R
int_2 = Integer(In=S.R)  # -> Kernel, R
S_2 = Series(S=S.R, N=number_slider_3, C=int)  # -> Kernel, R
S_3 = Series(S=number_slider_2, N=number_slider_3, C=int_2.R)  # -> Kernel, R
S_4 = Series(S=number_slider_2, N=S.R, C=int)  # -> Kernel, R
m_v = MatchVectors(Vector1=S_3.R, Vector2=int_2.R)  # -> Kernel, Vector1, Vector2
computer = Computer(Kernel=S_2.Kernel)  # disabled
computer_2 = Computer(Kernel=S_4.Kernel)  # disabled
S_5 = Series(S=m_v.Vector1, N=number_slider_3, C=m_v.Vector2)  # -> Kernel, R
computer_3 = Computer(Kernel=S_5.Kernel)

vectortolist = VectorToList(Vector=S_3.R)
vectortolist_2 = VectorToList(Vector=S_2.R)
vectortolist_3 = VectorToList(Vector=S_4.R)
vectortolist_4 = VectorToList(Vector=S.R)
vectortolist_5 = VectorToList(Vector=S_5.R)

subtraction = Subtraction(A=vectortolist_5, B=series_5)
panel = Panel(vectortolist_5)  # disabled
panel_2 = Panel(subtraction)  # disabled

# ----
# Evaluation
subtraction_2 = Subtraction(A=vectortolist_4, B=series)
panel_3 = Panel(subtraction_2)  # disabled
panel_4 = Panel(vectortolist_4)  # disabled

# ----
# Evaluation
subtraction_3 = Subtraction(A=vectortolist, B=series_2)
ma = MassAddition(Input=subtraction_3)  # -> Result, PartialResults
panel_5 = Panel(ma.Result)  # disabled
panel_6 = Panel(vectortolist)  # disabled

# ----
# Evaluation
subtraction_4 = Subtraction(A=vectortolist_3, B=series_3)
ma_2 = MassAddition(Input=subtraction_4)  # -> Result, PartialResults
panel_7 = Panel(vectortolist_3)  # disabled
panel_8 = Panel(ma_2.Result)

# ----
# Evaluation
subtraction_5 = Subtraction(A=vectortolist_2, B=series_4)
panel_9 = Panel(subtraction_5)
panel_10 = Panel(vectortolist_2)
