# Grasshopper definition absolute_test.gh (Grasshopper 1.0.8)
# plug-ins: GHOpenCL, GHParallelFlow

pi = Pi(Factor=Slider(2, range=0..10))
dom = ConstructDomain(DomainStart=0, DomainEnd=pi)
int = Integer(Slider(200, range=0..1000))
number_slider = Slider(1000, range=0..1000)
range = Range(Domain=dom, Steps=int)  # -> Kernel, R
range_2 = Range(Domain=dom, Steps=int)
sin = Sine(X=range.R)  # -> Kernel, Y
a_b = Multiplication(A=sin.Y, B=number_slider, Cross_reference=False)  # -> Kernel, R
sin_2 = Sine(Value=range_2)
multiplication = Multiplication(A=sin_2, B=number_slider)
int_2 = Integer(In=a_b.R)  # -> Kernel, R
round = Round(Number=multiplication)  # -> Nearest, Floor, Ceiling
abs = Absolute(X=sin.Y)  # -> Kernel, Y
abs_2 = Absolute(X=int_2.R)  # -> Kernel, Y
abs_3 = Absolute(Value=sin_2)
abs_4 = Absolute(Value=round.Floor)
v_l = VectorToList(Vector=abs.Y)
v_l_2 = VectorToList(Vector=abs_2.Y)
computer = Computer(Kernel=abs.Kernel)
computer_2 = Computer(Kernel=abs_2.Kernel)
subtraction = Subtraction(A=v_l, B=abs_3)
subtraction_2 = Subtraction(A=v_l_2, B=abs_4)
panel = Panel(subtraction)
panel_2 = Panel(subtraction_2)
