# Grasshopper definition arccosTest.gh (Grasshopper 1.0.8)
# plug-ins: GHOpenCL, GHParallelFlow

neg = Negative(Value=Slider(1, range=0..1))
dom = ConstructDomain(DomainStart=neg, DomainEnd=1)
int = Integer(Slider(1000, range=0..1000))

range = Range(Domain=dom, Steps=int)  # -> Kernel, R
acos = ArcCosine(X=range.R)  # -> Kernel, Y
computer = Computer(Kernel=acos.Kernel)

range_2 = Range(Domain=dom, Steps=int)
acos_2 = ArcCosine(Value=range_2)

v_l = VectorToList(Vector=acos.Y)
subtraction = Subtraction(A=v_l, B=acos_2)
panel = Panel(subtraction)
