# Grasshopper definition average.gh (Grasshopper 1.0.8)
# plug-ins: GHOpenCL, GHParallelFlow

number_slider = Slider(100, range=0..100)
number_slider_2 = Slider(1, range=0..1)
number_slider_3 = Slider(2, range=0..10)
number_slider_4 = Slider(100, range=0..100)
number_slider_5 = Slider(1, range=0..100)
number_slider_6 = Slider(0, range=0..100)
int = Integer(number_slider_4)
int_2 = Integer(Slider(2000, range=2..100000))

dom = ConstructDomain(A=number_slider_5, B=number_slider, Cross_reference=False)  # -> Kernel, R
range = Range(Domain=dom.R, Steps=int_2)  # -> Kernel, R
avr = Average(Input=range.R)  # -> Kernel, Result
computer = Computer(Kernel=avr.Kernel)  # disabled

dom_2 = ConstructDomain(DomainStart=number_slider_5, DomainEnd=number_slider)
range_2 = Range(Domain=dom_2, Steps=int_2)
avr_2 = Average(Input=range_2)

int_3 = Integer(Slider(100, range=0..1000))

S = Series(S=number_slider_2, N=number_slider_3, C=int)  # -> Kernel, R
dom_3 = ConstructDomain(A=number_slider_6, B=S.R, Cross_reference=False)  # -> Kernel, R
range_3 = Range(Domain=dom_3.R, Steps=int_3)  # -> Kernel, R
avr_3 = Average(Input=range_3.R)  # -> Kernel, Result
computer_2 = Computer(Kernel=avr_3.Kernel)

series = Series(Start=number_slider_2, Step=number_slider_3, Count=number_slider_4)
dom_4 = ConstructDomain(DomainStart=number_slider_6, DomainEnd=series)
range_4 = Range(Domain=dom_4, Steps=int_3)
avr_4 = Average(Input=range_4)

vectortolist = VectorToList(Vector=avr.Result)
panel = Panel(avr_2)
panel_2 = Panel(vectortolist)
vectortolist_2 = VectorToList(Vector=avr_3.Result)
subtraction = Subtraction(A=vectortolist_2, B=avr_4)
panel_3 = Panel(subtraction)
