# Grasshopper definition coordinate test.gh (Grasshopper 1.0.8)
# plug-ins: GHOpenCL, GHParallelFlow

panel = Panel("""0
4""")
panel_2 = Panel("""0
1
2
4""")
panel_3 = Panel("""0
1
2
4
7
9""")
number_slider = Slider(10, range=0..10)
number_slider_2 = Slider(984, range=0..1000)
number_slider_3 = Slider(10000, range=0..10000)
int = Integer(panel)
int_2 = Integer(panel_2)
int_3 = Integer(panel_3)
listtovector = ListToVector(List=int, Float=False)
listtovector_2 = ListToVector(List=int_2, Float=False)
int_4 = Integer(number_slider)
listtovector_3 = ListToVector(List=int_3, Float=False)
fg = FlagGenerator(Sia=listtovector, Count=int_4)  # -> R, Kernel
fg_2 = FlagGenerator(Sia=listtovector_2, Count=int_4)  # -> R, Kernel
fg_3 = FlagGenerator(Sia=listtovector_3, Count=int_4)  # -> R, Kernel
repeat = RepeatData(Data="false", Length=number_slider)
vectortolist = VectorToList(Vector=fg.R)
int_5 = Integer(vectortolist)
int_6 = Integer(In=fg_2.R)  # -> R, Kernel
vectortolist_2 = VectorToList(Vector=int_6.R)
int_7 = Integer(In=fg_3.R)  # -> R, Kernel
vectortolist_3 = VectorToList(Vector=int_7.R)
bool = Boolean(repeat)
toggle = BooleanToggle(True)
int_8 = Integer(vectortolist_2)
listtovector_4 = ListToVector(List=int_5, Float=False)
int_9 = Integer(vectortolist_3)
panel_4 = Panel(int_5)
panel_5 = Panel(int_8)
listtovector_5 = ListToVector(List=bool, Float=False)
panel_6 = Panel(int_9)
segscn = SegmentedScan(Data=int_6.R, StartFlags=fg.R, Inclusive=toggle)  # -> R, Kernel
segscn_2 = SegmentedScan(Data=int_7.R, StartFlags=fg_2.R, Inclusive=toggle)  # -> R, Kernel
segscn_3 = SegmentedScan(Data=listtovector_4, StartFlags=listtovector_5, Inclusive=toggle)  # -> R, Kernel; disabled
vectortolist_4 = VectorToList(Vector=segscn_3.R)
merge = Merge(Data1=fg.Kernel, Data2=segscn_3.Kernel, Data3=flatten(fg_2.Kernel), Data4=flatten(segscn.Kernel), Data5=segscn_2.Kernel)  # -> flatten(Result)
vectortolist_5 = VectorToList(Vector=segscn_2.R)
vectortolist_6 = VectorToList(Vector=segscn.R)
int_10 = Integer(vectortolist_4)
computer = Computer(Kernel=merge)
int_11 = Integer(vectortolist_5)
int_12 = Integer(vectortolist_6)
panel_8 = Panel(int_10)
panel_9 = Panel(int_11)
panel_10 = Panel(int_12)
