# Grasshopper definition division.gh (Grasshopper 1.0.8)
# plug-ins: GHOpenCL, GHParallelFlow

number_slider = Slider(2, range=0..10)
number_slider_2 = Slider(10, range=0..10)
dom = ConstructDomain(DomainStart=0, DomainEnd=Slider(100, range=0..100))
int = Integer(Slider(10, range=0..100))

range = Range(Domain=dom, Steps=int)  # -> Kernel, R
S = Series(S=number_slider_2, N=number_slider, C=int)  # -> Kernel, R
a_b = Division(A=range.R, B=S.R, Cross_reference=False)  # -> Kernel, R
computer = Computer(Kernel=a_b.Kernel)

range_2 = Range(Domain=dom, Steps=int)
series = Series(Start=number_slider_2, Step=number_slider, Count=int)
division = Division(A=range_2, B=series)

v_l = VectorToList(Vector=a_b.R)
subtraction = Subtraction(A=v_l, B=division)
panel = Panel(subtraction)
