# Grasshopper definition elementwise_sum.gh (Grasshopper 1.0.8)
# plug-ins: GHOpenCL, GHParallelFlow

dom = ConstructDomain(DomainStart=0, DomainEnd=1)
int = Integer(Slider(100, range=0..100))
int_2 = Integer(Slider(10, range=0..10))
ran = Random(Domain=dom, Count=int, Seed=int_2)  # -> Kernel, R
S = Series(S=Slider(1, range=0..1), N=Slider(100, range=0..100), C=int)  # -> Kernel, R
sum = Sum(X=[ran.R, S.R])  # -> Kernel, Result
prd = Product(X=[S.R, ran.R])  # -> Kernel, Result
computer = Computer(Kernel=sum.Kernel)
computer_2 = Computer(Kernel=prd.Kernel)
v_l = VectorToList(Vector=prd.Result)
panel = Panel(v_l)
