# Grasshopper definition evaluate_curve.gh (Grasshopper 1.0.8)
# plug-ins: GHOpenCL, GHParallelFlow

crv = Curve(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)
arc = CircularArc({Angle=0, Angle=0.8168563136, Plane=Plane(origin=(-33, 0, 12), x=(0.6246950476, 0, -0.7808688094), y=(0.7808688094, 0, 0.6246950476)), Radius=32.01562119})
line = Line(Line((-32, -9, 0), (26, 3, 0)))
int = Integer(Slider(128, range=0..1000))
topoly = CurveToPolyline(Curve=crv, ToleranceDistance=Slider(1, range=0..10), ToleranceAngle=0)  # -> Polyline, Segments
num = Number(topoly.Segments)

dom = ConstructDomain(A=Slider(0, range=0..1), B=Slider(1, range=0..10), Cross_reference=False)  # -> Kernel, R
range = Range(Domain=dom.R, Steps=int)  # -> Kernel, R
eval = EvaluateCurve(C=arc, T=range.R)  # -> Kernel, P, T
computer = Computer(Kernel=eval.Kernel)  # disabled

dom_2 = ConstructDomain(A=Slider(0, range=0..1), B=num, Cross_reference=False)  # -> Kernel, R

dom_3 = ConstructDomain(A=Slider(0, range=0..1), B=Slider(1, range=0..1), Cross_reference=False)  # -> Kernel, R
range_2 = Range(Domain=dom_3.R, Steps=int)  # -> Kernel, R
eval_2 = EvaluateCurve(C=line, T=range_2.R)  # -> Kernel, P, T
computer_2 = Computer(Kernel=eval_2.Kernel)  # disabled

range_3 = Range(Domain=dom_2.R, Steps=int)  # -> Kernel, R
eval_3 = EvaluateCurve(C=topoly.Polyline, T=range_3.R)  # -> Kernel, P, T
computer_3 = Computer(Kernel=eval_3.Kernel)
v_l = VectorToList(Vector=eval_3.P)
v_l_2 = VectorToList(Vector=eval.P)
v_l_3 = VectorToList(Vector=eval_2.P)
