# Grasshopper definition exclusive scan.gh (Grasshopper 1.0.8)
# plug-ins: RhinoCodePluginGH, GHOpenCL, GHParallelFlow

number_slider = Slider(100, range=0..100)
number_slider_2 = Slider(1000, range=0..1000)
number_slider_3 = Slider(99, range=0..100)
number_slider_4 = Slider(4850, range=0..10000)
number_slider_5 = Slider(700, range=0..100000)
number_slider_6 = Slider(21, range=0..100)
random = Random(Range=Domain(0, 1), Number=number_slider_5, Seed=2)
series = Series(Start=0, Step=1, Count=number_slider_5)
multiplication = Multiplication(A=random, B=100)
int = Integer(series)
panel = Panel("""1
2
3
4
5
6
7
8
9
10
11
12
13
14""")
int_2 = Integer([77, 40, 17, 99, 11, 31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])
int_3 = Integer(int)
listtovector = ListToVector(List=int_3, Float=False)

# ---- group: inclusive
c_script = CSharpScript(x=int_3)  # -> out, a; inputs x: list of Int32
# ---------- c_script: C# ----------
// Grasshopper Script Instance
#region Usings
using System;
using System.Linq;
using System.Collections;
using System.Collections.Generic;
using System.Drawing;

using Rhino;
using Rhino.Geometry;

using Grasshopper;
using Grasshopper.Kernel;
using Grasshopper.Kernel.Data;
using Grasshopper.Kernel.Types;
#endregion

public class Script_Instance : GH_ScriptInstance
{
    #region Notes
    /* 
      Members:
        RhinoDoc RhinoDocument
        GH_Document GrasshopperDocument
        IGH_Component Component
        int Iteration

      Methods (Virtual & overridable):
        Print(string text)
        Print(string format, params object[] args)
        Reflect(object obj)
        Reflect(object obj, string method_name)
    */
    #endregion

    private void RunScript(List<int> x, ref object a)
    {
        // Write your logic here
        int[] result = new int[x.Count];
        int temp = 0;
        for (int i = 0; i < x.Count; i++)
        {
            temp+= x[i];
            result[i] = temp;
            

        }
        a = result;
    }
}
# ---------- end c_script ----------

# ---- group: exclusive
c_script_2 = CSharpScript(x=int_3)  # -> out, a; inputs x: list of Int32
# ---------- c_script_2: C# ----------
// Grasshopper Script Instance
#region Usings
using System;
using System.Linq;
using System.Collections;
using System.Collections.Generic;
using System.Drawing;

using Rhino;
using Rhino.Geometry;

using Grasshopper;
using Grasshopper.Kernel;
using Grasshopper.Kernel.Data;
using Grasshopper.Kernel.Types;
#endregion

public class Script_Instance : GH_ScriptInstance
{
    #region Notes
    /* 
      Members:
        RhinoDoc RhinoDocument
        GH_Document GrasshopperDocument
        IGH_Component Component
        int Iteration

      Methods (Virtual & overridable):
        Print(string text)
        Print(string format, params object[] args)
        Reflect(object obj)
        Reflect(object obj, string method_name)
    */
    #endregion

    private void RunScript(List<int> x, ref object a)
    {
        // Write your logic here
        int[] result = new int[x.Count];
        int temp = 0;
        for (int i = 0; i < x.Count; i++)
        {
            result[i] = temp;
            temp+= x[i];

        }
        a = result;
    }
}
# ---------- end c_script_2 ----------

# ----
pres = PrefixSum(A=listtovector, Inc=Toggle(False))  # -> R, Kernel
computer = Computer(Kernel=pres.Kernel)
vectortolist = VectorToList(Vector=pres.R)
subtraction = Subtraction(A=c_script_2.a, B=vectortolist)
ma = MassAddition(Input=subtraction)  # -> Result, PartialResults
panel_2 = Panel(subtraction)
