# Grasshopper definition globaltolocal.gh (Grasshopper 1.0.8)
# plug-ins: GHOpenCL, GHParallelFlow

number_slider = Slider(100000, range=0..210000)
number_slider_2 = Slider(10, range=0..10)
number_slider_3 = Slider(200, range=0..1000)
range = Range(Domain=Domain(0, 1), Number=number_slider, Float=False)  # -> Result, Kernel
number_slider_4 = Slider(73, range=0..100)
range_2 = Range(Domain=Domain(0, 1), Steps=number_slider)
srf = Surface(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)
multiplication = Multiplication(A=range.Result, B=number_slider_2)  # -> R, Kernel
multiplication_2 = Multiplication(A=range.Result, B=number_slider_3)  # -> R, Kernel
planar = IsPlanar(Surface=srf, Interior=True)  # -> Planar, Plane
multiplication_3 = Multiplication(A=range_2, B=number_slider_2)
multiplication_4 = Multiplication(A=range_2, B=number_slider_3)
pt = ConstructXyzPoint(X1=multiplication.R, X2=multiplication_2.R, X3=number_slider_4)  # -> Result, Kernel
pt_2 = ConstructPoint(XCoordinate=multiplication_3, YCoordinate=multiplication_4, ZCoordinate=number_slider_4)
plcoord = PlaneCoordinates(Point=pt_2, System=planar.Plane)  # -> XCoordinate, YCoordinate, ZCoordinate
global_local = GlobalLocal(Point=pt.Result, Frame=planar.Plane)  # -> Result, Kernel
computer = Computer(Kernel=global_local.Kernel)
vectortolist = VectorToList(Vector=global_local.Result)
