# Grasshopper definition graftVector.gh (Grasshopper 1.0.8)
# plug-ins: GHOpenCL, GHParallelFlow

number_slider = Slider(100, range=0..100)
number_slider_2 = Slider(0, range=0..100)
number_slider_3 = Slider(10, range=0..10)
int = Integer(number_slider)

# ----
# GPU
S = Series(S=number_slider_2, N=number_slider_3, C=int)  # -> Kernel, R
graft = GraftVector(V=S.R)  # -> Kernel, V
panel = Panel(graft.V)
m_v = MatchVectors(Vector1=graft.V, Vector2=S.R)  # -> Kernel, Vector1, Vector2
panel_2 = Panel(m_v.Vector2)
addition = Addition(A=m_v.Vector1, B=m_v.Vector2, Cross_reference=False)  # -> Kernel, R
computer = Computer(Kernel=addition.Kernel)

# ----
# CPU
series = Series(Start=number_slider_2, Step=number_slider_3, Count=number_slider)
graft_2 = GraftTree(Tree=series, IncludeEmptyLists=True, IncludeNullItems=True)
addition_2 = Addition(A=series, B=graft_2)

vectortolist = VectorToList(Vector=addition.R)
subtraction = Subtraction(A=vectortolist, B=addition_2)
panel_3 = Panel(subtraction)
