# Grasshopper definition grasshopper data structure.gh (Grasshopper 1.0.8)

number_slider = Slider(5, range=0..10)
series = Series(Start=number_slider, Step=1, Count=Slider(3, range=0..10))
series_2 = Series(Start=0, Step=1, Count=number_slider)
panel = Panel(series)
panel_2 = Panel(series_2)
pshift = ShiftPaths(Data=series, Offset=1)
entwine = Entwine(Branch00=series_2, Branch01=series, FlattenInputs=True)
entwine_2 = Entwine(Branch0X=series_2, Branch1X=series, Branch2X=series_2, FlattenInputs=False)  # -> graft(Result)
merge = Merge(Data1=series_2, Data2=pshift)
panel_3 = Panel(merge)
panel_4 = Panel(entwine)
panel_5 = Panel(entwine_2)
addition = Addition(A=entwine, B=entwine_2)
viewer = ParamViewer(panel_5)
viewer_2 = ParamViewer(panel_4)
panel_6 = Panel(addition)
viewer_3 = ParamViewer(panel_6)
