# Grasshopper definition linePlaneIntersection.gh (Grasshopper 1.0.8)
# plug-ins: GHOpenCL, GHParallelFlow

number_slider = Slider(20, range=0..100)
num = Number("-20")
number_slider_2 = Slider(10, range=0..1000)
number_slider_3 = Slider(0, range=0..1)
int = Integer(Slider(10000, range=10..1000000))
pt = ConstructPoint(XCoordinate=0, YCoordinate=0, ZCoordinate=Slider(93, range=0..100))
vec = VectorXYZ(XComponent=Slider(0.1, range=-1..1), YComponent=Slider(-0.3, range=-1..1), ZComponent=Slider(0.3, range=-1..1))  # -> Vector, Length
pt_2 = ConstructPoint(XCoordinate=0, YCoordinate=0, ZCoordinate=0)

dom = ConstructDomain(A=num, B=number_slider, Cross_reference=False)  # -> Kernel, R
range = Range(Domain=dom.R, Number=int)  # -> Result, Kernel
pt_3 = ConstructXyzPoint(X=range.Result, Y=number_slider_3, Z=number_slider_2)  # -> Kernel, Point
pl_nr = PlaneNormal(A=pt, B=vec.Vector, Cross_reference=False)  # -> Kernel, R
lin = Line(A=pt_2, B=pt_3.Point, Cross_reference=False)  # -> Kernel, R
plx = LinePlane(Line=lin.R, Plane=pl_nr.R)  # -> Kernel, Point, T
computer = Computer(Kernel=plx.Kernel)

dom_2 = ConstructDomain(DomainStart=num, DomainEnd=number_slider)
range_2 = Range(Domain=dom_2, Steps=int)
pt_4 = ConstructPoint(XCoordinate=range_2, YCoordinate=number_slider_3, ZCoordinate=number_slider_2)
pl = PlaneNormal(Origin=pt, ZAxis=vec.Vector)
ln = Line(StartPoint=pt_2, EndPoint=pt_4)
plx_2 = LinePlane(Line=ln, Plane=pl)  # -> Point, ParamL, ParamP

vectortolist = VectorToList(Vector=plx.Point)
vectortolist_2 = VectorToList(Vector=plx.T)
dist = Distance(PointA=plx_2.Point, PointB=vectortolist)
subtraction = Subtraction(A=plx_2.ParamL, B=vectortolist_2)
panel = Panel(dist)
panel_2 = Panel(subtraction)
