# Grasshopper definition loop_simple.gh (Grasshopper 1.0.8)
# plug-ins: GHOpenCL, GHParallelFlow

push = Push(In=Slider(10, range=0..10))  # -> Kernel, Out
a_b = Addition(A=push.Out, B=Slider(1, range=0..1), Cross_reference=False)  # -> Kernel, R
assignment = Assignment(Left=push.Out, Right=a_b.R)
loop = Loop(Iteraton=Slider(43, range=0..100), Kernel=assignment)
pull = Pull(Input=push.Out)
v_l = VectorToList(Vector=pull)
panel = Panel(v_l)
