# Grasshopper definition mass_addition.gh (Grasshopper 1.0.8)
# plug-ins: GHOpenCL, GHParallelFlow

number_slider = Slider(100, range=0..100)
number_slider_2 = Slider(1, range=0..1)
number_slider_3 = Slider(2, range=0..10)
number_slider_4 = Slider(100, range=0..100)
number_slider_5 = Slider(1, range=0..100)
number_slider_6 = Slider(0, range=0..100)
int = Integer(number_slider_4)
int_2 = Integer(Slider(2000, range=2..100000))

dom = ConstructDomain(A=number_slider_5, B=number_slider, Cross_reference=False)  # -> Kernel, R
range = Range(Domain=dom.R, Steps=int_2)  # -> Kernel, R
σa = MassAddition(Input=range.R)  # -> Kernel, Result
computer = Computer(Kernel=σa.Kernel)  # disabled

dom_2 = ConstructDomain(DomainStart=number_slider_5, DomainEnd=number_slider)
range_2 = Range(Domain=dom_2, Steps=int_2)
ma = MassAddition(Input=range_2)  # -> Result, PartialResults

int_3 = Integer(Slider(100, range=0..1000))

S = Series(S=number_slider_2, N=number_slider_3, C=int)  # -> Kernel, R
dom_3 = ConstructDomain(A=number_slider_6, B=S.R, Cross_reference=False)  # -> Kernel, R
range_3 = Range(Domain=dom_3.R, Steps=int_3)  # -> Kernel, R
σa_2 = MassAddition(Input=range_3.R)  # -> Kernel, Result
computer_2 = Computer(Kernel=σa_2.Kernel)

series = Series(Start=number_slider_2, Step=number_slider_3, Count=number_slider_4)
dom_4 = ConstructDomain(DomainStart=number_slider_6, DomainEnd=series)
range_4 = Range(Domain=dom_4, Steps=int_3)
ma_2 = MassAddition(Input=range_4)  # -> Result, PartialResults

vectortolist = VectorToList(Vector=σa.Result)
panel = Panel(ma.Result)
panel_2 = Panel(vectortolist)
vectortolist_2 = VectorToList(Vector=σa_2.Result)
ma_3 = MassAddition(Input=vectortolist_2)  # -> Result, PartialResults
subtraction = Subtraction(A=ma_3.Result, B=ma_2.Result)
panel_3 = Panel(vectortolist_2)
panel_4 = Panel(subtraction)
