# Grasshopper definition mass_multiplication.gh (Grasshopper 1.0.8)
# plug-ins: GHOpenCL, GHParallelFlow

number_slider = Slider(0.7, range=0..1)
number_slider_2 = Slider(0.001, range=0..1)
int = Integer(Slider(7, range=0..100))
int_2 = Integer(Slider(10000, range=5..100000))

S = Series(S=number_slider, N=number_slider_2, C=int_2)  # -> Kernel, R
part = PartitionList(V=S.R, S=int)  # -> Kernel, P
m_mul = MassMultiplication(Input=S.R)  # -> Kernel, Result
m_mul_2 = MassMultiplication(Input=part.P)  # -> Kernel, Result
computer = Computer(Kernel=m_mul_2.Kernel)
computer_2 = Computer(Kernel=m_mul.Kernel)

series = Series(Start=number_slider, Step=number_slider_2, Count=int_2)
partition = PartitionList(List=series, Size=int)
mm = MassMultiplication(Input=series)  # -> Result, PartialResults
mm_2 = MassMultiplication(Input=partition)  # -> Result, PartialResults

v_l = VectorToList(Vector=m_mul.Result)
v_l_2 = VectorToList(Vector=m_mul_2.Result)
panel = Panel(mm.Result)
panel_2 = Panel(mm_2.Result)
panel_3 = Panel(v_l_2)
panel_4 = Panel(v_l)
