# Grasshopper definition mesh_boundary_shade - triremesh.gh (Grasshopper 1.0.8)
# plug-ins: GHOpenCL, GHParallelFlow, Kangaroo2 Components

mesh = Mesh(<mesh referenced from the Rhino model>)
triremesh = TriRemesh(Geometry=mesh, Sharp=True, Length=Slider(1, range=0..50), Iterations=25)  # -> Triangulation, Dual, Creases
nv = NakedVertices(Mesh=triremesh.Triangulation)  # -> ClothedIndex, NakedIndex, ClothedPts, NakedPts
demesh = DeconstructMesh(Mesh=triremesh.Triangulation)  # -> Vertices, Faces, Colours, Normals

# ----
# GPU
# ≈1.5x faster than c#
# ≈2.5x faster than c#
# ≈5x faster than c#
listtovector = ListToVector(List=demesh.Vertices, Float=False)
listtovector_2 = ListToVector(List=nv.NakedPts, Float=False)
lng = ListLength(List=nv.NakedPts)
toggle = BooleanToggle(True)
int = Integer(lng)
listtovector_3 = ListToVector(List=nv.NakedPts, Float=toggle)
listtovector_4 = ListToVector(List=demesh.Vertices, Float=toggle)

graft = GraftVector(V=listtovector)  # -> Kernel, V
m_v = MatchVectors(Vector1=graft.V, Vector2=listtovector_2)  # -> Kernel, Vector1, Vector2
dist = Distance(A=m_v.Vector1, B=m_v.Vector2, Cross_reference=False)  # -> Kernel, R
num = Number("-1")
pow = Power(A=dist.R, B=num, Cross_reference=False)  # -> Kernel, R
σa = MassAddition(Input=pow.R)  # -> Kernel, Result
flatten = Flatten(SV=σa.Result)  # -> Kernel, V
vectortolist = VectorToList(Vector=flatten.V)
# ≈  c#
computer = Computer(Kernel=flatten.Kernel)

dist_2 = Distance(A=listtovector_2, B=listtovector, Cross_reference=True)  # -> Kernel, R; disabled
num_2 = Number("-1")
pow_2 = Power(A=dist_2.R, B=num_2, Cross_reference=False)  # -> Kernel, R
part = PartitionList(V=pow_2.R, S=int)  # -> Kernel, P
σa_2 = MassAddition(Input=part.P)  # -> Kernel, Result
flatten_2 = Flatten(SV=σa_2.Result)  # -> Kernel, V
vectortolist_2 = VectorToList(Vector=flatten_2.V)
computer_2 = Computer(Kernel=flatten_2.Kernel)  # disabled

# ----
# ≈1.5x Faster than c#
c_script = CSharpScript(M=triremesh.Triangulation, P=nv.NakedPts)  # -> out, R; inputs M: Mesh, P: list of Point3d
# ---------- c_script: C# ----------
    int vc = M.Vertices.Count;
    int pc = P.Count;
    double[] vals = new double[vc];
    for(int i = 0;i < vc;i++){
      double tot = 0;
      for(int j = 0;j < pc;j++){
        tot += 1 / (P[j].DistanceTo((Point3d)M.Vertices[i]));
      }
      vals[i] = tot;
    }
    R = vals;
# ---------- end c_script ----------

# ----
# ≈1.5x Faster than c#
dist_3 = Distance(PointA=graft(demesh.Vertices), PointB=nv.NakedPts)  # disabled
pow_3 = Power(A=dist_3, B=-1)
ma = MassAddition(Input=pow_3)  # -> flatten(Result), PartialResults

invdis = InverseDistance(A=listtovector_4, B=listtovector_3, Cross_reference=True)  # -> Kernel, R; disabled
part_2 = PartitionList(V=invdis.R, S=int)  # -> Kernel, P
σa_3 = MassAddition(Input=part_2.P)  # -> Kernel, Result
flatten_3 = Flatten(SV=σa_3.Result)  # -> Kernel, V
computer_3 = Computer(Kernel=flatten_3.Kernel)  # disabled
vectortolist_3 = VectorToList(Vector=flatten_3.V)

invdis_2 = InverseDistance(A=listtovector_2, B=listtovector, Cross_reference=True)  # -> Kernel, R; disabled
part_3 = PartitionList(V=invdis_2.R, S=int)  # -> Kernel, P
σa_4 = MassAddition(Input=part_3.P)  # -> Kernel, Result
flatten_4 = Flatten(SV=σa_4.Result)  # -> Kernel, V
vectortolist_4 = VectorToList(Vector=flatten_4.V)
computer_4 = Computer(Kernel=flatten_4.Kernel)  # disabled

num_3 = Number(vectortolist)
bnd = Bounds(Numbers=num_3)
remap = RemapNumbers(Value=num_3, Source=bnd, Target=Slider(0.375, range=0..4))  # -> Mapped, Clipped
nullrep = ReplaceNulls(Items=remap.Clipped, Replacements=1)  # -> Items, Count
gradient = Gradient(LowerLimit=0, UpperLimit=1, Parameter=nullrep.Items, stops=[0: RGB(255, 255, 255), 1: RGB(0, 0, 0)])
conmesh = ConstructMesh(Vertices=demesh.Vertices, Faces=demesh.Faces, Colours=gradient)
