# Grasshopper definition modulus.gh (Grasshopper 1.0.8)
# plug-ins: GHOpenCL, GHParallelFlow

number_slider = Slider(20, range=0..100)
number_slider_2 = Slider(0, range=0..1)
number_slider_3 = Slider(4, range=0..1000)
int = Integer(Slider(100, range=0..100))
S = Series(S=number_slider_2, N=number_slider_3, C=int)  # -> Kernel, R
series = Series(Start=number_slider_2, Step=number_slider_3, Count=int)
S_2 = Series(S=number_slider_2, N=number_slider_3, C=int)  # -> Kernel, R
int_2 = Integer(series)
int_3 = Integer(number_slider)
int_4 = Integer(In=S.R)  # -> Kernel, R
mod = Modulus(A=int_4.R, B=int_3, Cross_reference=False)  # -> Kernel, R
mod_2 = Modulus(A=int_2, B=int_3)
mod_3 = Modulus(A=S_2.R, B=number_slider, Cross_reference=False)  # -> Kernel, R
mod_4 = Modulus(A=series, B=number_slider)
v_l = VectorToList(Vector=mod.R)
v_l_2 = VectorToList(Vector=mod_3.R)
subtraction = Subtraction(A=v_l, B=mod_2)
computer = Computer(Kernel=mod.Kernel)
subtraction_2 = Subtraction(A=v_l_2, B=mod_4)
computer_2 = Computer(Kernel=mod_3.Kernel)
panel = Panel(subtraction)
panel_2 = Panel(subtraction_2)
