# Grasshopper definition pointInside.gh (Grasshopper 1.0.8)
# plug-ins: GHOpenCL, GHParallelFlow

# ----
# 101*101 grid of points
number_slider = Slider(1000, range=0..1000)
dom = ConstructDomain(DomainStart=0, DomainEnd=number_slider)
range = Range(Domain=dom, Steps=Slider(100, range=0..100))
pt = ConstructPoint(XCoordinate=range, YCoordinate=graft(range), ZCoordinate=0)  # -> flatten(Point)

# ----
# polyline with 1.6 K points
number_slider_2 = Slider(2, range=0..10)
crv = Curve(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)
topoly = CurveToPolyline(Curve=crv, ToleranceDistance=0, ToleranceAngle=0, MaxEdge=number_slider_2)  # -> Polyline, Segments

# ---- group: list to vector
listtovector = ListToVector(List=pt, Float=False)

# ----
# Point containment in GPU
xy = XYPlane(Origin=Point(0, 0, 0))
incrv = PointInCurve(C=topoly.Polyline, P=listtovector, F=xy)  # -> C, P, Kernel
computer = Computer(Kernel=incrv.Kernel)

# ----
# Point containment in CPU
incurve = PointInCurve(Point=pt, Curve=topoly.Polyline)  # -> flatten(Relationship), flatten(Point)

# ---- group: vector to list
vectortolist = VectorToList(Vector=incrv.C)
vectortolist_2 = VectorToList(Vector=incrv.P)

# ----
# Filter points outside the curve
panel = Panel("2")
# Filter points outside the curve
equals = Equality(FirstNumber=flatten(incurve.Relationship), SecondNumber=panel)  # -> Equality, Inequality
cull = CullPattern(List=flatten(incurve.Point), CullPattern=flatten(equals.Equality))

equals_2 = Equality(FirstNumber=flatten(vectortolist), SecondNumber="2")  # -> Equality, Inequality
cull_2 = CullPattern(List=flatten(vectortolist_2), CullPattern=flatten(equals_2.Equality))
