# Grasshopper definition prefixSum.gh (Grasshopper 1.0.8)
# plug-ins: RhinoCodePluginGH, GHOpenCL, GHParallelFlow

# ----
# Generating random integers
number_slider = Slider(5000, range=0..100000)
random = Random(Range=Domain(0, 1), Number=number_slider, Seed=2)
multiplication = Multiplication(A=random, B=100)
int = Integer(multiplication)

toggle = BooleanToggle(False)

listtovector = ListToVector(List=int, Float=False)
# GPU
pres = PrefixSum(A=listtovector, Inc=toggle)  # -> Kernel, R
computer = Computer(Kernel=pres.Kernel)

# ----
# CPU
c_script = CSharpScript(x=int, inclusive=toggle)  # -> out, a; inputs x: list of Int32, inclusive: Boolean
# ---------- c_script: C# ----------
// Grasshopper Script Instance
#region Usings
using System;
using System.Linq;
using System.Collections;
using System.Collections.Generic;
using System.Drawing;

using Rhino;
using Rhino.Geometry;

using Grasshopper;
using Grasshopper.Kernel;
using Grasshopper.Kernel.Data;
using Grasshopper.Kernel.Types;
#endregion

public class Script_Instance : GH_ScriptInstance
{
    #region Notes
    /* 
      Members:
        RhinoDoc RhinoDocument
        GH_Document GrasshopperDocument
        IGH_Component Component
        int Iteration

      Methods (Virtual & overridable):
        Print(string text)
        Print(string format, params object[] args)
        Reflect(object obj)
        Reflect(object obj, string method_name)
    */
    #endregion

    private void RunScript(List<int> x, bool inclusive, ref object a)
    {
        // Write your logic here
        int[] result = new int[x.Count];
        int temp = 0;
        if (inclusive)
        {
            for (int i = 0; i < x.Count; i++)
            {
                temp+= x[i];
                result[i] = temp;
                

            }
        }else{
            for (int i = 0; i < x.Count; i++)
            {
                result[i] = temp;
                temp+= x[i];

            }
        }
        a = result;
    }
}
# ---------- end c_script ----------
vectortolist = VectorToList(Vector=pres.R)

# ---- group: Validating results
subtraction = Subtraction(A=flatten(c_script.a), B=flatten(vectortolist))
ma = MassAddition(Input=subtraction)  # -> Result, PartialResults
panel = Panel(subtraction)
panel_2 = Panel(ma.Result)
