# Grasshopper definition relative_diff.gh (Grasshopper 1.0.8)
# plug-ins: GHOpenCL, GHParallelFlow

number_slider = Slider(1, range=0..100)
number_slider_2 = Slider(3, range=0..10)
int = Integer(Slider(1000, range=0..1000))
dom = ConstructDomain(DomainStart=0, DomainEnd=Slider(100, range=0..100))

S = Series(S=number_slider, N=number_slider_2, C=int)  # -> Kernel, R
rel_diff = RelativeDifferences(V=S.R)  # -> Kernel, D
computer = Computer(Kernel=rel_diff.Kernel)

int_2 = Integer(In=S.R)  # -> Kernel, R
range = Range(Domain=dom, Steps=int_2.R)  # -> Kernel, R
rel_diff_2 = RelativeDifferences(V=range.R)  # -> Kernel, D
computer_2 = Computer(Kernel=rel_diff_2.Kernel)

series = Series(Start=number_slider, Step=number_slider_2, Count=int)
reldif = RelativeDifferences(Values=series)

range_2 = Range(Domain=dom, Steps=series)
reldif_2 = RelativeDifferences(Values=range_2)

v_l = VectorToList(Vector=rel_diff.D)
v_l_2 = VectorToList(Vector=rel_diff_2.D)
panel = Panel(v_l)
subtraction = Subtraction(A=v_l_2, B=reldif_2)
