# Grasshopper definition remap numbers.gh (Grasshopper 1.0.8)
# plug-ins: GHOpenCL, GHParallelFlow

dom = ConstructDomain(DomainStart=0, DomainEnd=Slider(100, range=0..100))
dom_2 = ConstructDomain(DomainStart=Slider(0.5, range=0..1), DomainEnd=1)
dom_3 = ConstructDomain(DomainStart=Slider(0.1, range=0..0.1), DomainEnd=Slider(0.7, range=0..1))

# ----
# number of items
number_slider = Slider(100000, range=0..1000000)
int = Integer(number_slider)

# ----
# GPU
range = Range(Domain=dom, Steps=int)  # -> Kernel, R
remap = RemapNumbers(V=range.R, S=dom_2, T=dom_3)  # -> Kernel, R, C
computer = Computer(Kernel=remap.Kernel)

# ----
# CPU
range_2 = Range(Domain=dom, Steps=number_slider)
remap_2 = RemapNumbers(Value=range_2, Source=dom_2, Target=dom_3)  # -> Mapped, Clipped

vectortolist = VectorToList(Vector=remap.C)

# ----
# Validation
subtraction = Subtraction(A=remap_2.Clipped, B=vectortolist)
panel = Panel(subtraction)
