# Grasshopper definition replace item test.gh (Grasshopper 1.0.8)
# plug-ins: GHOpenCL, GHParallelFlow

dom = ConstructDomain(DomainStart=0, DomainEnd=1)
int = Integer(Slider(0, range=0..100))
int_2 = Integer(Slider(5, range=0..10))
int_3 = Integer(Slider(30, range=0..100))
int_4 = Integer(Slider(100, range=0..1000))
int_5 = Integer(Slider(4, range=0..100))
int_6 = Integer(Slider(5, range=0..10))
int_7 = Integer(Slider(0, range=0..100))
int_8 = Integer(Slider(10, range=0..100))
int_9 = Integer(Slider(4, range=0..10))
int_10 = Integer(Slider(5, range=0..100))
range = Range(Domain=dom, Steps=int_4)  # -> Kernel, R
S = Series(S=int, N=int_2, C=int_3)  # -> Kernel, R
range_2 = Range(Domain=dom, Steps=int_4)
series = Series(Start=int, Step=int_2, Count=int_3)
toggle = BooleanToggle(True)
S_2 = Series(S=int_5, N=int_6, C=int_8)  # -> Kernel, R
S_3 = Series(S=int_7, N=int_9, C=int_10)  # -> Kernel, R
num = Number("-1")
panel = Panel(series)
lng = ListLength(List=range_2)
part = PartitionList(V=range.R, S=S_2.R)  # -> Kernel, P
panel_2 = Panel(lng)
v_l = VectorToList(Vector=S_3.R)
replace = ReplaceItems(List=range_2, Item=num, Indices=series, Wrap=toggle)
r_i = ReplaceItems(Vector=range.R, Item=num, Index=S.R, Wrap=toggle)  # -> Kernel, Result
r_i_2 = ReplaceItems(Vector=part.P, Item=num, Index=S_3.R, Wrap=Toggle(False))  # -> Kernel, Result
panel_3 = Panel(v_l)
v_l_2 = VectorToList(Vector=r_i.Result)
panel_4 = Panel(replace)
computer = Computer(Kernel=r_i.Kernel)  # disabled
subtraction = Subtraction(A=v_l_2, B=replace)
computer_2 = Computer(Kernel=r_i_2.Kernel)
panel_5 = Panel(v_l_2)
v_l_3 = VectorToList(Vector=r_i_2.Result)
panel_6 = Panel(v_l_3)
panel_7 = Panel(subtraction)
