# Grasshopper definition round.gh (Grasshopper 1.0.8)
# plug-ins: GHOpenCL, GHParallelFlow

dom = ConstructDomain(DomainStart=0, DomainEnd=Slider(100, range=0..100))
int = Integer(Slider(1000, range=0..1000))
range = Range(Domain=dom, Steps=int)  # -> Kernel, R
range_2 = Range(Domain=dom, Steps=int)
round = Round(X=range.R)  # -> Kernel, N, F, C
round_2 = Round(Number=range_2)  # -> Nearest, Floor, Ceiling
v_l = VectorToList(Vector=round.F)
v_l_2 = VectorToList(Vector=round.N)
v_l_3 = VectorToList(Vector=round.C)
computer = Computer(Kernel=round.Kernel)
subtraction = Subtraction(A=v_l_2, B=round_2.Nearest)
subtraction_2 = Subtraction(A=v_l_3, B=round_2.Ceiling)
subtraction_3 = Subtraction(A=v_l, B=round_2.Floor)
panel = Panel(subtraction_2)
