# Grasshopper definition segmented sxclusive scan.gh (Grasshopper 1.0.8)
# plug-ins: RhinoCodePluginGH, GHOpenCL, GHParallelFlow

# ----
# Generating integer numbers
number_slider = Slider(10000, range=0..100000)
series = Series(Start=0, Step=1, Count=number_slider)
int = Integer(series)

# ----
# Generating flags
number_slider_2 = Slider(2, range=0..10)
random = Random(Range=Domain(0, 1), Number=number_slider, Seed=number_slider_2)
smaller = SmallerThan(FirstNumber=random, SecondNumber=Slider(0.1, range=0..0.1))  # -> SmallerThan, OrEqualTo
replace = ReplaceItems(List=smaller.SmallerThan, Item=Toggle(True), Indices=0, Wrap=False)

int_2 = Integer(int)
toggle = BooleanToggle(True)

listtovector = ListToVector(List=smaller.SmallerThan, Float=False)
# GPU
listtovector_2 = ListToVector(List=int_2, Float=False)
segscn = SegmentedScan(Data=listtovector_2, StartFlags=listtovector, Inclusive=toggle)  # -> Kernel, R
computer = Computer(Kernel=segscn.Kernel)

# ----
# CPU
c_script = CSharpScript(x=int, y=replace, inc=toggle)  # -> out, a; inputs x: list of Int32, y: list of Boolean, inc: Boolean
# ---------- c_script: C# ----------
// Grasshopper Script Instance
#region Usings
using System;
using System.Linq;
using System.Collections;
using System.Collections.Generic;
using System.Drawing;

using Rhino;
using Rhino.Geometry;

using Grasshopper;
using Grasshopper.Kernel;
using Grasshopper.Kernel.Data;
using Grasshopper.Kernel.Types;
#endregion

public class Script_Instance : GH_ScriptInstance
{
    #region Notes
    /* 
      Members:
        RhinoDoc RhinoDocument
        GH_Document GrasshopperDocument
        IGH_Component Component
        int Iteration

      Methods (Virtual & overridable):
        Print(string text)
        Print(string format, params object[] args)
        Reflect(object obj)
        Reflect(object obj, string method_name)
    */
    #endregion

    private void RunScript(List<int> x, List<bool> y, bool inc, ref object a)
    {
        // Write your logic here
        int[] result = new int[x.Count];
        int temp = inc? x[0]: 0;
        if (inc)
        {
            for (int i = 0; i < x.Count; i++)
            {
                if (y[i])
                {
                    temp = 0;
                }
                
                temp+= x[i];
                result[i] = temp;

            }
        }else{
            for (int i = 0; i < x.Count; i++)
            {
                if (y[i])
                {
                    temp = 0;
                }
                result[i] = temp;
                temp+= x[i];

            }
        }
        a = result;
    }
}
# ---------- end c_script ----------

vectortolist = VectorToList(Vector=segscn.R)

# ----
# Validation
subtraction = Subtraction(A=c_script.a, B=vectortolist)
panel = Panel(subtraction)
ma = MassAddition(Input=subtraction)  # -> Result, PartialResults
panel_2 = Panel(ma.Result)
