# Grasshopper definition trignometric functions.gh (Grasshopper 1.0.8)
# plug-ins: GHOpenCL, GHParallelFlow

number_slider = Slider(100000, range=10..100000)
number_slider_2 = Slider(0, range=0..100)
number_slider_3 = Slider(0.01, range=0..1)
int = Integer(number_slider)

series = Series(Start=number_slider_2, Step=number_slider_3, Count=number_slider)
sin = Sine(Value=series)
cos = Cosine(Value=series)
addition = Addition(A=sin, B=cos)

S = Series(S=number_slider_2, N=number_slider_3, C=int)  # -> Kernel, R
cos_2 = Cosine(Input=S.R)  # -> Kernel, Result
sin_2 = Sine(Input=S.R)  # -> Kernel, Result
addition_2 = Addition(A=sin_2.Result, B=cos_2.Result, Cross_reference=False)  # -> Kernel, R
computer = Computer(Kernel=addition_2.Kernel)

vectortolist = VectorToList(Vector=addition_2.R)
subtraction = Subtraction(A=vectortolist, B=addition)
ma = MassAddition(Input=subtraction)  # -> Result, PartialResults
panel = Panel(ma.Result)
