# Grasshopper definition variabelCashTestINsegmentedScan.gh (Grasshopper 1.0.8)
# plug-ins: GHOpenCL, GHParallelFlow

number_slider = Slider(2000, range=0..10000)
random = Random(Range=Domain(0, 1), Number=number_slider, Seed=2)
series = Series(Start=0, Step=1, Count=number_slider)
larger = LargerThan(FirstNumber=random, SecondNumber=0.96)  # -> LargerThan, OrEqualTo
listtovector = ListToVector(List=series, Float=False)
listtovector_2 = ListToVector(List=larger.LargerThan, Float=False)
segscn = SegmentedScan(Data=listtovector, StartFlags=listtovector_2, Inclusive=Toggle(False))  # -> Kernel, R
computer = Computer(Kernel=segscn.Kernel)
