# Grasshopper definition variableCashTest.gh (Grasshopper 1.0.8)
# plug-ins: GHOpenCL, GHParallelFlow

number_slider = Slider(90, range=0..100)
random = Random(Range=Domain(0, 1), Number=number_slider, Seed=2)
series = Series(Start=0, Step=1, Count=number_slider)
listtovector = ListToVector(List=random, Float=False)
listtovector_2 = ListToVector(List=series, Float=False)
addition = Addition(A=series, B=random)
number_slider_2 = Slider(2, range=0..10)
addition_2 = Addition(A=listtovector_2, B=listtovector, Cross_reference=False)  # -> Kernel, R
subtraction = Subtraction(A=addition_2.R, B=listtovector, Cross_reference=False)  # -> Kernel, R
subtraction_2 = Subtraction(A=addition, B=random)
multiplication = Multiplication(A=addition_2.R, B=subtraction.R, Cross_reference=False)  # -> Kernel, R
multiplication_2 = Multiplication(A=addition, B=subtraction_2)
vectortolist = VectorToList(Vector=multiplication.R)
computer = Computer(Kernel=multiplication.Kernel)
subtraction_3 = Subtraction(A=vectortolist, B=multiplication_2)
panel = Panel(subtraction_3)
